# Grasshopper definition BarcelonaBlocksOptimizer.ghx (Grasshopper 1.0.8)
# plug-ins: ShapeDiverForGrasshopper

# ---- group: INPUTS
courtyard_side = Slider(0.476, range=0.35..0.65)
block_side = Slider(0.739, range=0.7..0.8)
corner_cut = Slider(12.95, range=10..18)

# ----
ma = MassAddition(Input=[block_side, courtyard_side, corner_cut])  # -> Result, PartialResults
entwine = Entwine(
    Branch00=block_side,
    Branch01=block_side,
    Branch02=block_side,
    Branch03=block_side,
    Branch04=block_side,
    Branch05=block_side,
    Branch06=block_side,
    Branch07=block_side,
    Branch08=block_side,
    FlattenInputs=True)  # -> flatten(Result)
entwine_2 = Entwine(
    Branch00=courtyard_side,
    Branch01=courtyard_side,
    Branch02=courtyard_side,
    Branch03=courtyard_side,
    Branch04=courtyard_side,
    Branch05=courtyard_side,
    Branch06=courtyard_side,
    Branch07=courtyard_side,
    Branch08=courtyard_side,
    FlattenInputs=True)  # -> flatten(Result)
dom = ConstructDomain(DomainStart="4", DomainEnd="9")
multiplication = Multiplication(A=ma.Result, B="100")
base_surface = Geometry(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)
random = Random(Range=dom, Number=180, Seed=multiplication)
num = Number(random)
sddp = ShapeDiverDocumentPayload({AbsoluteTolerance=0, AngleTolerance=0, DistanceDisplayPrecision=0, GltfVersion="Gltf2", GrasshopperVersion="1.0.0008", InputGroups="{}", OutputGroups="{}", RelativeTolerance=0, RhinoVersion="8.6.24101.5001", UnitSystem=0, VersionCreated="1.17.0.0", VersionSaved="1.17.1.0"})

sqgrid = Square(Plane=PlaneXY(0, 0, 0), Size="100", ExtentX="3", ExtentY="3")  # -> flatten(Cells), Points
area = Area(Geometry=sqgrid.Cells)  # -> Area, Centroid
panel = Panel("0.9")
scale = Scale(Geometry=sqgrid.Cells, Center=area.Centroid, Factor=entwine)  # -> Geometry, Transform
area_2 = Area(Geometry=scale.Geometry)  # -> Area, Centroid
scale_2 = Scale(Geometry=scale.Geometry, Center=area_2.Centroid, Factor=entwine_2)  # -> Geometry, Transform
explode = Explode(Curve=scale_2.Geometry, Recursive=True)  # -> Segments, Vertices
explode_2 = Explode(Curve=scale.Geometry, Recursive=True)  # -> Segments, Vertices
divide = DivideCurve(Curve=explode.Segments, Count="4", Kinks=False)  # -> Points, Tangents, Parameters
crv_cp = CurveClosestPoint(Point=divide.Points, Curve=graft(explode_2.Segments))  # -> Point, Parameter, Distance
disc = Discontinuity(Curve=scale.Geometry, Level=1)  # -> Points, Parameters
disc_2 = Discontinuity(Curve=scale_2.Geometry, Level=1)  # -> Points, Parameters
ln = Line(StartPoint=crv_cp.Point, EndPoint=divide.Points)
shift = ShiftList(List=ln, Shift=1, Wrap=False)
edgesrf = EdgeSurface(CurveA=ln, CurveB=shift)  # -> simplify(Surface)
rec_2pt = Rectangle2Pt(Plane=PlaneXY(0, 0, 0), PointA=disc.Points, PointB=disc_2.Points, Radius=0)  # -> simplify(Rectangle), Length
cull_i = CullIndex(List=reverse(edgesrf), Indices=0, Wrap=True)  # -> reverse(List)
fillet = Fillet(Curve=scale.Geometry, Radius=corner_cut)
boundary = BoundarySurfaces(Edges=rec_2pt.Rectangle)
trim = TrimTree(Tree=cull_i, Depth=2)
disc_3 = Discontinuity(Curve=fillet, Level=2)  # -> Points, Parameters
pline = PolyLine(Vertices=disc_3.Points, Closed=True)  # -> flatten(Polyline)
Z = UnitZ(Factor=216)
offset = OffsetCurve(Curve=pline, Distance="4.5", Corners=1)  # -> flatten(Curve)
offset_2 = OffsetCurve(Curve=pline, Distance="6", Corners=1)  # -> flatten(Curve)
Z_2 = UnitZ(Factor="-.15")
extr = Extrude(Base=pline, Direction=Z)
splitmul = SplitBrepMultiple(Brep=boundary, Cutters=pline)
extr_2 = Extrude(Base=offset_2, Direction=Z_2)
move = Move(Geometry=extr, Motion=expr("-0.5*x", Z))  # -> Geometry, Transform
divide_2 = DivideCurve(Curve=offset, Count=28, Kinks=False)  # -> Points, Tangents, Parameters
item = ListItem(List=splitmul, Index=0, Wrap=True)
cap = CapHoles(Brep=extr_2)
merge = Merge(Data1=simplify(trim), Data2=simplify(item))  # -> flatten(Result)
mesh = Mesh(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)
mesh_2 = Mesh(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)
move_2 = Move(Geometry=base_surface, Motion=Z_2)  # -> Geometry, Transform
move_3 = Move(Geometry=mesh_2, Motion=divide_2.Points)  # -> Geometry, Transform
move_4 = Move(Geometry=mesh, Motion=divide_2.Points)  # -> Geometry, Transform
area_3 = Area(Geometry=merge)  # -> Area, Centroid
multiplication_2 = Multiplication(A=num, B="3.5")
multiplication_3 = Multiplication(A=area_3.Area, B=multiplication_2)
dispatch = Dispatch(List=multiplication_3, DispatchPattern=[True, False])  # -> ListA, ListB
area_4 = Area(Geometry=scale.Geometry)  # -> Area, Centroid
ma_2 = MassAddition(Input=area_3.Area)  # -> Result, PartialResults
area_5 = Area(Geometry=base_surface)  # -> Area, Centroid
ma_3 = MassAddition(Input=area_4.Area)  # -> Result, PartialResults
ma_4 = MassAddition(Input=flatten(dispatch.ListB))  # -> Result, PartialResults
subtraction = Subtraction(A=area_5.Area, B=ma_3.Result)
area_6 = Area(Geometry=scale_2.Geometry)  # -> Area, Centroid
total_ground_floor_area = Number(ma_2.Result)
int = Integer(ma_4.Result)
len = Length(Curve=[scale_2.Geometry, pline])
ma_5 = MassAddition(Input=flatten(area_6.Area))  # -> Result, PartialResults

# ----
# App Builder components
panel_2 = Panel("{ type: \"optimizer\", props : { } }")
buildcontainer = BuildContainer(Name="right", Widgets=panel_2)
buildapp = BuildApp(Containers=buildcontainer)

# ---- group: Geometry
Z_3 = UnitZ(Factor=multiplication_2)
extr_3 = Extrude(Base=merge, Direction=Z_3)
mesh_3 = Mesh(extr_3)
preview = CustomPreview(Geometry=move_4.Geometry, Material=ColourSwatch(SwatchColor=RGB(135, 240, 103)))
preview_2 = CustomPreview(Geometry=move_3.Geometry, Material=ColourSwatch(SwatchColor=RGB(110, 83, 25)))
preview_3 = CustomPreview(Geometry=move_2.Geometry, Material=ColourSwatch(SwatchColor=RGB(163, 160, 160)))
preview_4 = CustomPreview(Geometry=cap, Material=ColourSwatch(SwatchColor=RGB(219, 219, 219)))
preview_5 = CustomPreview(Geometry=mesh_3, Material=ColourSwatch(SwatchColor=RGB(255, 255, 255)))

# ----
multiplication_4 = Multiplication(A=len, B="18")

# ---- group: OBJECTIVES
courtayrd_area_to_max = Number(ma_5.Result)
street_area_to_max = Number(subtraction)
volume_to_max = Number(int)
facade_area_to_min = Number(multiplication_4)
division = Division(A=1, B=volume_to_max)
division_2 = Division(A=1, B=courtayrd_area_to_max)
division_3 = Division(A=1, B=street_area_to_max)

# ----
# Objectives data output
panel_3 = Panel("Courtyard area")
merge_2 = Merge(Data1=division, Data2=division_2, Data3=division_3)  # -> flatten(Result)
merge_3 = Merge(Data1="Volume", Data2=panel_3, Data3="Street area")
constructjson = ConstructJSON(Data=graft(merge_2), AddressString=merge_3)
objectives = DirectDataOutput(Data=constructjson)
panel_4 = Panel(constructjson)
