# Grasshopper definition HotDog.ghx (Grasshopper 1.0.8)
# plug-ins: PluginTemplate, ShapeDiverForGrasshopper

list = ValueList({"Meat": 0, "Vegetarion": 1}, selected="Meat")

# ----
# Input paramaters
topping1 = ValueList({"chili": 0, "Onions": 1, "Sauerkraut": 2, "pickles": 3, "Tomatoes": 4, "Jalapejos": 5, "Bell Peppers": 6, "Coleslaw": 7, "Cheddar Cheese": 8, "American Cheese": 9}, selected="American Cheese")
topping2 = ValueList({"chili": 0, "Onions": 1, "Sauerkraut": 2, "pickles": 3, "Tomatoes": 4, "Jalapejos": 5, "Bell Peppers": 6, "Coleslaw": 7, "Cheddar Cheese": 8, "American Cheese": 9}, selected="pickles")
toppingamount1 = Slider(1, range=0..1)
toppingamount2 = Slider(0.5, range=0..1)
sauceamount1 = Slider(1, range=0..1)
sauceamount2 = Slider(0.66, range=0..1)
sausagesize = Slider(1.2, range=0.8..1.2)
sauce1 = ValueList({"Mayonaise": 0, "Ketchup": 1, "Mustard": 2, "BBQ Sauce": 3, "Sweet Chili": 4, "Hot Sauce": 5}, selected="Ketchup")
sauce2 = ValueList({"Mayonaise": 0, "Ketchup": 1, "Mustard": 2, "BBQ Sauce": 3, "Sweet Chili": 4, "Hot Sauce": 5}, selected="Mayonaise")
bun = ValueList({"bun": 0, "pretzelBun": 1}, selected="pretzelBun")
sausagesize_2 = Number(sausagesize)
sausagetype = Integer(list)
sauceamount1_2 = Number(sauceamount1)
saucetype1 = Integer(sauce1)
sauceamount2_2 = Number(sauceamount2)
saucetype2 = Integer(sauce2)
toppingamount1_2 = Number(toppingamount1)
toppingtype1 = Integer(topping1)
toppingamount2_2 = Number(toppingamount2)
toppingtype2 = Integer(topping2)
buntype = Number(bun)

num = Number(0.4)

# ----
# Create weights
subtraction = Subtraction(A=sausagesize_2, B=0.8)
division = Division(A=subtraction, B=0.4)
multiplication = Multiplication(A=division, B=10)
filter = StreamFilter(Gate=sausagetype, Stream0=multiplication, Stream1=0)
filter_2 = StreamFilter(Gate=sausagetype, Stream0=0, Stream1=multiplication)
filter_3 = StreamFilter(Gate=buntype, Stream0=num, Stream1=0)
filter_4 = StreamFilter(Gate=buntype, Stream0=0, Stream1=num)
merge = Merge(Data1=filter, Data2=filter_2)
merge_2 = Merge(Data1=sauceamount1_2, Data2=sauceamount2_2)
merge_3 = Merge(Data1=saucetype1, Data2=saucetype2)
merge_4 = Merge(Data1=toppingamount1_2, Data2=toppingamount2_2)
merge_5 = Merge(Data1=toppingtype1, Data2=toppingtype2)
merge_6 = Merge(Data1=filter_3, Data2=filter_4)
multiplication_2 = Multiplication(A=merge_6, B=10)
multiplication_3 = Multiplication(A=merge, B=10)
dup = DuplicateData(Data=0, Number=6, Order=True)
dup_2 = DuplicateData(Data=0, Number=10, Order=True)
ins = InsertItems(List=dup, Item=merge_2, Indices=merge_3, Wrap=True)
ins_2 = InsertItems(List=dup_2, Item=merge_4, Indices=merge_5, Wrap=True)
multiplication_4 = Multiplication(A=ins, B=10)
multiplication_5 = Multiplication(A=ins_2, B=10)

# ----
# Scores
item = ListItem(List=multiplication_3, Index=0, Wrap=True)  # -> Item, Item1
item_2 = ListItem(List=multiplication_4, Index=0, Wrap=True)  # -> Item, Item1, Item2, Item3, Item4, Item5, Item6
item_3 = ListItem(List=multiplication_5, Index=0, Wrap=True)  # -> Item, Item1, Item2, Item3, Item4, Item5, Item6, Item7, Item8, Item9
item_4 = ListItem(List=multiplication_2, Index=0, Wrap=True)  # -> Item, Item1
python = GhPythonScript(
    meat=item.Item,
    vegan_alternative=item.Item1,
    ketchup=item_2.Item,
    mustard=item_2.Item1,
    mayonnaise=item_2.Item2,
    bbq_sauce=item_2.Item3,
    hot_sauce=item_2.Item4,
    relish=item_2.Item5,
    cheese_sauce=item_2.Item6,
    chili=item_3.Item,
    raw_onions=item_3.Item1,
    sauerkraut=item_3.Item2,
    pickles=item_3.Item3,
    tomatoes=item_3.Item4,
    jalapenos=item_3.Item5,
    bell_peppers=item_3.Item6,
    coleslaw=item_3.Item7,
    cheddar_cheese=item_3.Item8,
    american_cheese=item_3.Item9,
    bun=item_4.Item,
    pretzel_bun=item_4.Item1)  # -> juiciness, acidity, crunchiness, sweetness, saltiness, umami, cost, calories, carbs, fat
# ---------- python: Python ----------
class HotDog:
    def __init__(self):
        # Initialize all ingredients with a score of 0
        self.ingredients = {
            'meat': 0.0, 'vegan_alternative': 0.0, 'ketchup': 0.0,
            'mustard': 0.0, 'mayonnaise': 0.0, 'bbq_sauce': 0.0,
            'hot_sauce': 0.0, 'relish': 0.0, 'chili': 0.0,
            'cheese_sauce': 0.0, 'raw_onions': 0.0, 'sauerkraut': 0.0,
            'pickles': 0.0, 'tomatoes': 0.0, 'jalapenos': 0.0,
            'bell_peppers': 0.0, 'coleslaw': 0.0, 'cheddar_cheese': 0.0,
            'american_cheese': 0.0, 'bun': 0.0, 'pretzel_bun': 0.0
        }

# Detailed sensory and cost profiles for each ingredient scaled 0 to 10, with zeros included
        self.sensory_profiles = {
            'juiciness': {'meat': 9, 'vegan_alternative': 5, 'ketchup': 3, 'mustard': 1,
                          'mayonnaise': 2, 'bbq_sauce': 2, 'hot_sauce': 1, 'relish': 3,
                          'chili': 7, 'cheese_sauce': 4, 'raw_onions': 1, 'sauerkraut': 0,
                          'pickles': 1, 'tomatoes': 8, 'jalapenos': 0, 'bell_peppers': 0,
                          'coleslaw': 2, 'cheddar_cheese': 0, 'american_cheese': 0, 'bun': 1, 'pretzel_bun': 1},
            'acidity': {'meat': 0, 'vegan_alternative': 0, 'ketchup': 7, 'mustard': 8,
                        'mayonnaise': 1, 'bbq_sauce': 4, 'hot_sauce': 8, 'relish': 6,
                        'chili': 3, 'cheese_sauce': 0, 'raw_onions': 2, 'sauerkraut': 9,
                        'pickles': 8, 'tomatoes': 4, 'jalapenos': 6, 'bell_peppers': 2,
                        'coleslaw': 3, 'cheddar_cheese': 1, 'american_cheese': 0, 'bun': 0, 'pretzel_bun': 0},
            'crunchiness': {'meat': 0, 'vegan_alternative': 2, 'ketchup': 0, 'mustard': 0,
                            'mayonnaise': 0, 'bbq_sauce': 0, 'hot_sauce': 0, 'relish': 1,
                            'chili': 0, 'cheese_sauce': 0, 'raw_onions': 9, 'sauerkraut': 1,
                            'pickles': 8, 'tomatoes': 0, 'jalapenos': 5, 'bell_peppers': 7,
                            'coleslaw': 1, 'cheddar_cheese': 0, 'american_cheese': 0, 'bun': 1, 'pretzel_bun': 4},
            'sweetness': {'meat': 0, 'vegan_alternative': 0, 'ketchup': 8, 'mustard': 2,
                          'mayonnaise': 1, 'bbq_sauce': 6, 'hot_sauce': 0, 'relish': 7,
                          'chili': 2, 'cheese_sauce': 0, 'raw_onions': 0, 'sauerkraut': 0,
                          'pickles': 5, 'tomatoes': 5, 'jalapenos': 0, 'bell_peppers': 1,
                          'coleslaw': 2, 'cheddar_cheese': 0, 'american_cheese': 0, 'bun': 2, 'pretzel_bun': 3},
            'saltiness': {'meat': 7, 'vegan_alternative': 3, 'ketchup': 4, 'mustard': 6,
                          'mayonnaise': 5, 'bbq_sauce': 5, 'hot_sauce': 6, 'relish': 3,
                          'chili': 7, 'cheese_sauce': 0, 'raw_onions': 0, 'sauerkraut': 6,
                          'pickles': 7, 'tomatoes': 0, 'jalapenos': 4, 'bell_peppers': 1,
                          'coleslaw': 2, 'cheddar_cheese': 6, 'american_cheese': 6, 'bun': 4, 'pretzel_bun': 5},
            'umami': {'meat': 9, 'vegan_alternative': 4, 'ketchup': 0, 'mustard': 2,
                      'mayonnaise': 0, 'bbq_sauce': 3, 'hot_sauce': 2, 'relish': 1,
                      'chili': 8, 'cheese_sauce': 4, 'raw_onions': 0, 'sauerkraut': 2,
                      'pickles': 1, 'tomatoes': 2, 'jalapenos': 3, 'bell_peppers': 0,
                      'coleslaw': 1, 'cheddar_cheese': 3, 'american_cheese': 2, 'bun': 1, 'pretzel_bun': 2},
            'cost': {'meat': 1.5, 'vegan_alternative': 1.8, 'ketchup': 0.15, 'mustard': 0.20,
                     'mayonnaise': 0.20, 'bbq_sauce': 0.25, 'hot_sauce': 0.20, 'relish': 0.30,
                     'chili': 1.0, 'cheese_sauce': 0.50, 'raw_onions': 0.15, 'sauerkraut': 0.40,
                     'pickles': 0.30, 'tomatoes': 0.30, 'jalapenos': 0.30, 'bell_peppers': 0.30,
                     'coleslaw': 0.45, 'cheddar_cheese': 0.50, 'american_cheese': 0.40, 'bun': 0.50, 'pretzel_bun': 0.80},
            'calories': {
                'meat': 250, 'vegan_alternative': 180, 'ketchup': 20, 'mustard': 10, 'mayonnaise': 100,
                'bbq_sauce': 30, 'hot_sauce': 5, 'relish': 15, 'chili': 80, 'cheese_sauce': 50,
                'raw_onions': 10, 'sauerkraut': 13, 'pickles': 8, 'tomatoes': 5, 'jalapenos': 4,
                'bell_peppers': 3, 'coleslaw': 25, 'cheddar_cheese': 113, 'american_cheese': 104,
                'bun': 140, 'pretzel_bun': 180
            },
            'carbs': {
                'meat': 0, 'vegan_alternative': 10, 'ketchup': 5, 'mustard': 1, 'mayonnaise': 0.1,
                'bbq_sauce': 7, 'hot_sauce': 1, 'relish': 4, 'chili': 8, 'cheese_sauce': 5,
                'raw_onions': 2, 'sauerkraut': 3, 'pickles': 2, 'tomatoes': 1, 'jalapenos': 1,
                'bell_peppers': 2, 'coleslaw': 3, 'cheddar_cheese': 1, 'american_cheese': 2,
                'bun': 28, 'pretzel_bun': 36
            },
            'fat': {
                'meat': 20, 'vegan_alternative': 9, 'ketchup': 0.1, 'mustard': 0.2, 'mayonnaise': 10,
                'bbq_sauce': 0.5, 'hot_sauce': 0, 'relish': 0, 'chili': 5, 'cheese_sauce': 4,
                'raw_onions': 0.1, 'sauerkraut': 0.1, 'pickles': 0.1, 'tomatoes': 0.2, 'jalapenos': 0.2,
                'bell_peppers': 0.2, 'coleslaw': 1.5, 'cheddar_cheese': 9, 'american_cheese': 9,
                'bun': 2, 'pretzel_bun': 3
            },
        }

    def set_ingredient(self, ingredient, value):
        if ingredient in self.ingredients:
            self.ingredients[ingredient] = value

    def calculate_totals(self):
        totals = {metric: 0.0 for metric in self.sensory_profiles}
        # Calculate the weighted sum of all sensory attributes and cost
        for ingredient, value in self.ingredients.items():
            for metric, profile in self.sensory_profiles.items():
                if ingredient in profile:
                    totals[metric] += value * profile[ingredient] / 10  # Adjusting by the set value and scaling down

        return totals

# Example Usage
hot_dog = HotDog()
# Set each ingredient using the HotDog class
hot_dog.set_ingredient('meat', meat)
hot_dog.set_ingredient('vegan_alternative', vegan_alternative)
hot_dog.set_ingredient('ketchup', ketchup)
hot_dog.set_ingredient('mustard', mustard)
hot_dog.set_ingredient('mayonnaise', mayonnaise)
hot_dog.set_ingredient('bbq_sauce', bbq_sauce)
hot_dog.set_ingredient('hot_sauce', hot_sauce)
hot_dog.set_ingredient('relish', relish)
hot_dog.set_ingredient('chili', chili)
hot_dog.set_ingredient('cheese_sauce', cheese_sauce)
hot_dog.set_ingredient('raw_onions', raw_onions)
hot_dog.set_ingredient('sauerkraut', sauerkraut)
hot_dog.set_ingredient('pickles', pickles)
hot_dog.set_ingredient('tomatoes', tomatoes)
hot_dog.set_ingredient('jalapenos', jalapenos)
hot_dog.set_ingredient('bell_peppers', bell_peppers)
hot_dog.set_ingredient('coleslaw', coleslaw)
hot_dog.set_ingredient('cheddar_cheese', cheddar_cheese)
hot_dog.set_ingredient('american_cheese', american_cheese)
hot_dog.set_ingredient('bun', bun)
hot_dog.set_ingredient('pretzel_bun', pretzel_bun)

final_profile = hot_dog.calculate_totals()

juiciness = final_profile['juiciness']
acidity = final_profile['acidity']
crunchiness = final_profile['crunchiness']
sweetness = final_profile['sweetness']
saltiness = final_profile['saltiness']
umami = final_profile['umami']
cost = final_profile['cost']
calories = final_profile['calories']
carbs = final_profile['carbs']
fat = final_profile['fat']

print("Final Sensory Profile:", final_profile)
# ---------- end python ----------
entwine = Entwine(
    Branch00=python.juiciness,
    Branch01=python.acidity,
    Branch02=python.crunchiness,
    Branch03=python.sweetness,
    Branch04=python.saltiness,
    Branch05=python.umami,
    FlattenInputs=True)  # -> flatten(Result)
entwine_2 = Entwine(Branch00=python.calories, Branch01=python.carbs, Branch02=python.fat, FlattenInputs=True)  # -> flatten(Result)
ma = MassAddition(Input=entwine_2)  # -> Result, PartialResults

sausage_1 = Panel(multiplication_3)
sauces_2 = Panel(multiplication_4)
toppings_2 = Panel(multiplication_5)
bun_1 = Panel(multiplication_2)
num_2 = Number(41)
num_3 = Number(44)

vegetariancolor = ColourSwatch(SwatchColor=RGB(209, 125, 94))
sausagecolor = ColourSwatch(SwatchColor=RGB(212, 86, 40))
buncolor = ColourSwatch(SwatchColor=RGB(242, 223, 126))
buncolor_2 = ColourSwatch(SwatchColor=RGB(230, 195, 122))
# Viz
mesh = Mesh(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)
cluster = Cluster_4(B=toppingamount1_2, data=toppingtype1)  # -> G, color
cluster_2 = Cluster_5(B=toppingamount2_2, data=toppingtype2)  # -> G, color
filter_5 = StreamFilter(Gate=sausagetype, Stream0=sausagecolor, Stream1=vegetariancolor)
filter_6 = StreamFilter(Gate=buntype, Stream0=buncolor, Stream1=buncolor_2)
cluster_3 = Cluster_2(C=mesh, X=sausagesize_2)
cluster_4 = Cluster(i=saucetype1)
cluster_5 = Cluster(i=saucetype2)
platecolor = ColourSwatch(SwatchColor=RGB(209, 209, 209))
cluster_6 = Cluster_3(Z=num_3, B=sauceamount2_2)
cluster_7 = Cluster_3(Z=num_2, B=sauceamount1_2)
mesh_2 = Mesh(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)
mesh_3 = Mesh(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)
entwine_3 = Entwine(
    Branch00=mesh_2,
    Branch01=cluster_3,
    Branch02=mesh_3,
    Branch03=cluster_7,
    Branch04=cluster_6,
    Branch05=cluster.G,
    Branch06=cluster_2.G,
    FlattenInputs=True)
entwine_4 = Entwine(
    Branch00=filter_6,
    Branch01=filter_5,
    Branch02=platecolor,
    Branch03=cluster_4,
    Branch04=cluster_5,
    Branch05=cluster.color,
    Branch06=cluster_2.color,
    FlattenInputs=True)

# ----
# App Builder components
panel = Panel("{ type: \"optimizer\", props : { } }")
buildcontainer = BuildContainer(Name="right", Widgets=panel)
buildapp = BuildApp(Containers=buildcontainer)

ma_2 = MassAddition(Input=entwine)  # -> Result, PartialResults

col = Colour(entwine_4)
mesh_4 = Mesh(entwine_3)

# ----
# Output parameters
taste = Number(ma_2.Result)
cost = Number(python.cost)
health = Number(ma.Result)

gltfdisplay = GlTF20Display(Geometry=mesh_4, Material=flatten(col))
one_over_x = OneOverX(Value=taste)

# ----
# Objectives data output
panel_2 = Panel("Taste")
merge_7 = Merge(Data1=one_over_x, Data2=health, Data3=cost)  # -> flatten(Result)
merge_8 = Merge(Data1=panel_2, Data2="Health", Data3="Cost")
constructjson = ConstructJSON(Data=graft(merge_7), AddressString=merge_8)
objectives = DirectDataOutput(Data=constructjson)
panel_3 = Panel(constructjson)

# ==== cluster Cluster
mustard = ColourSwatch(SwatchColor=RGB(250, 215, 100))
ketchup = ColourSwatch(SwatchColor=RGB(217, 57, 39))
mayo = ColourSwatch(SwatchColor=RGB(255, 249, 217))
bbq = ColourSwatch(SwatchColor=RGB(255, 85, 66))
hot = ColourSwatch(SwatchColor=RGB(255, 25, 0))
merge = Merge(Data1=mayo, Data2=ketchup, Data3=mustard, Data4=bbq, Data5=hot)
i = ClusterInput()
item = ListItem(List=merge, Index=i, Wrap=True)
saucecolor = ClusterOutput(item)

# ==== cluster Cluster_2
C = ClusterInput()
bbox = BoundingBox(Content=C, Plane=PlaneXY(0, 0, 0))  # -> Box, Box_2
boxprop = BoxProperties(Box=bbox.Box)  # -> Center, Diagonal, Area, Volume, Degeneracy
X = ClusterInput()
scale_nu = ScaleNU(Geometry=C, Plane=boxprop.Center, ScaleX=X, ScaleY=1, ScaleZ=1)  # -> Geometry, Transform
G = ClusterOutput(scale_nu.Geometry)

# ==== cluster Cluster_3
B = ClusterInput()
multiplication = Multiplication(A=Slider(150, range=0..1000), B=B)
multiplication_2 = Multiplication(A=Slider(10, range=0..10), B=B)
subtraction = Subtraction(A=multiplication_2, B=1)
integer_division = IntegerDivision(A=multiplication, B=multiplication_2)
sqrt = SquareRoot(Value=multiplication_2)
multiplication_3 = Multiplication(A=subtraction, B=integer_division)
max = Maximum(A=Slider(2, range=0..10), B=sqrt)
division = Division(A=multiplication_3, B=2)
neg = Negative(Value=division)
min = Minimum(A=max, B=Slider(5, range=0..10))
number_slider = Slider(9, range=0..20)
series = Series(Start=neg, Step=integer_division, Count=multiplication_2)
Z = ClusterInput()
neg_2 = Negative(Value=number_slider)
merge = Merge(Data1=number_slider, Data2=neg_2)
repeat = RepeatData(Data=merge, Length=multiplication_2)
pt = ConstructPoint(XCoordinate=series, YCoordinate=repeat, ZCoordinate=Z)
intcrv = Interpolate(Vertices=pt, Degree=3, Periodic=False, KnotStyle=1)  # -> Curve, Length, Domain
pipe = Pipe(Curve=intcrv.Curve, Radius=min, Caps=2)
P = ClusterOutput(pipe)

# ==== cluster Cluster_4
data = ClusterInput()
data_2 = Data(data)
cheeseamericansize = Slider(4, range=0..10)
cheeseamericancolor = ColourSwatch(SwatchColor=RGB(255, 231, 112))
cheesecheddarcolor = ColourSwatch(SwatchColor=RGB(255, 218, 33))
bellpeppersize = Slider(15, range=0..15)
sauerkrautsize = Slider(8, range=0..10)
tomatosize = Slider(12, range=0..15)
coleslawsize = Slider(8, range=0..15)
jalapenosize = Slider(6, range=0..10)
bellpeppercolor = ColourSwatch(SwatchColor=RGB(255, 224, 23))
sauerkrautcolor = ColourSwatch(SwatchColor=RGB(235, 222, 164))
chilisize = Slider(1, range=0..10)
onionsize = Slider(5, range=0..10)
picklesize = Slider(9, range=0..10)
cheesesize = Slider(3, range=0..10)
jalapenocolor = ColourSwatch(SwatchColor=RGB(127, 148, 89))
coleslawcolor = ColourSwatch(SwatchColor=RGB(188, 222, 124))
tomatocolor = ColourSwatch(SwatchColor=RGB(240, 65, 65))
onioncolor = ColourSwatch(SwatchColor=RGB(217, 189, 117))
picklecolor = ColourSwatch(SwatchColor=RGB(152, 178, 102))
chilicolor = ColourSwatch(SwatchColor=RGB(148, 44, 44))
shape = BooleanToggle(True)
shape_2 = BooleanToggle(True)
shape_3 = BooleanToggle(True)
shape_4 = BooleanToggle(False)
shape_5 = BooleanToggle(False)
shape_6 = BooleanToggle(False)
shape_7 = BooleanToggle(False)
shape_8 = BooleanToggle(True)
shape_9 = BooleanToggle(True)
shape_10 = BooleanToggle(True)
filter = StreamFilter(
    Gate=data_2,
    Stream0=chilicolor,
    Stream1=onioncolor,
    Stream2=sauerkrautcolor,
    Stream3=picklecolor,
    Stream4=tomatocolor,
    Stream5=jalapenocolor,
    Stream6=bellpeppercolor,
    Stream7=coleslawcolor,
    Stream8=cheesecheddarcolor,
    Stream9=cheeseamericancolor)
filter_2 = StreamFilter(
    Gate=data_2,
    Stream0=chilisize,
    Stream1=onionsize,
    Stream2=sauerkrautsize,
    Stream3=picklesize,
    Stream4=tomatosize,
    Stream5=jalapenosize,
    Stream6=bellpeppersize,
    Stream7=coleslawsize,
    Stream8=cheesesize,
    Stream9=cheeseamericansize)
filter_3 = StreamFilter(
    Gate=data_2,
    Stream0=shape,
    Stream1=shape_2,
    Stream2=shape_3,
    Stream3=shape_4,
    Stream4=shape_5,
    Stream5=shape_6,
    Stream6=shape_7,
    Stream7=shape_8,
    Stream8=shape_9,
    Stream9=shape_10)
color = ClusterOutput(filter)
B = ClusterInput()
size = Size(G=filter_3, B=B, relay=filter_2)
G = ClusterOutput(size)

# ==== cluster Cluster_5
data = ClusterInput()
data_2 = Data(data)
cheeseamericansize = Slider(4, range=0..10)
cheeseamericancolor = ColourSwatch(SwatchColor=RGB(255, 231, 112))
cheesecheddarcolor = ColourSwatch(SwatchColor=RGB(255, 218, 33))
bellpeppersize = Slider(15, range=0..15)
sauerkrautsize = Slider(8, range=0..10)
tomatosize = Slider(12, range=0..15)
coleslawsize = Slider(8, range=0..15)
jalapenosize = Slider(6, range=0..10)
bellpeppercolor = ColourSwatch(SwatchColor=RGB(255, 224, 23))
sauerkrautcolor = ColourSwatch(SwatchColor=RGB(235, 222, 164))
chilisize = Slider(1, range=0..10)
onionsize = Slider(5, range=0..10)
picklesize = Slider(9, range=0..10)
cheesesize = Slider(3, range=0..10)
jalapenocolor = ColourSwatch(SwatchColor=RGB(127, 148, 89))
coleslawcolor = ColourSwatch(SwatchColor=RGB(188, 222, 124))
tomatocolor = ColourSwatch(SwatchColor=RGB(240, 65, 65))
onioncolor = ColourSwatch(SwatchColor=RGB(217, 189, 117))
picklecolor = ColourSwatch(SwatchColor=RGB(152, 178, 102))
chilicolor = ColourSwatch(SwatchColor=RGB(148, 44, 44))
shape = BooleanToggle(True)
shape_2 = BooleanToggle(True)
shape_3 = BooleanToggle(True)
shape_4 = BooleanToggle(False)
shape_5 = BooleanToggle(False)
shape_6 = BooleanToggle(False)
shape_7 = BooleanToggle(False)
shape_8 = BooleanToggle(True)
shape_9 = BooleanToggle(True)
shape_10 = BooleanToggle(True)
filter = StreamFilter(
    Gate=data_2,
    Stream0=chilicolor,
    Stream1=onioncolor,
    Stream2=sauerkrautcolor,
    Stream3=picklecolor,
    Stream4=tomatocolor,
    Stream5=jalapenocolor,
    Stream6=bellpeppercolor,
    Stream7=coleslawcolor,
    Stream8=cheesecheddarcolor,
    Stream9=cheeseamericancolor)
filter_2 = StreamFilter(
    Gate=data_2,
    Stream0=chilisize,
    Stream1=onionsize,
    Stream2=sauerkrautsize,
    Stream3=picklesize,
    Stream4=tomatosize,
    Stream5=jalapenosize,
    Stream6=bellpeppersize,
    Stream7=coleslawsize,
    Stream8=cheesesize,
    Stream9=cheeseamericansize)
filter_3 = StreamFilter(
    Gate=data_2,
    Stream0=shape,
    Stream1=shape_2,
    Stream2=shape_3,
    Stream3=shape_4,
    Stream4=shape_5,
    Stream5=shape_6,
    Stream6=shape_7,
    Stream7=shape_8,
    Stream8=shape_9,
    Stream9=shape_10)
color = ClusterOutput(filter)
B = ClusterInput()
size = Size_2(G=filter_3, B=B, relay=filter_2)
G = ClusterOutput(size)

# ==== cluster Size
number_slider = Slider(70, range=0..200)
number_slider_2 = Slider(10, range=0..10)
positionz = Slider(44, range=0..1000)
B = ClusterInput()
relay = ClusterInput()
neg = Negative(Value=number_slider)
neg_2 = Negative(Value=number_slider_2)
G = ClusterInput()
pt = ConstructPoint(XCoordinate=0, YCoordinate=0, ZCoordinate=positionz)
dom = ConstructDomain(DomainStart=number_slider, DomainEnd=neg)
dom_2 = ConstructDomain(DomainStart=number_slider_2, DomainEnd=neg_2)
number_slider_3 = Slider(2, range=0..10)
rectangle = Rectangle(Plane=pt, XSize=dom, YSize=dom_2, Radius=0)  # -> Rectangle, Length
multiplication = Multiplication(A=Slider(100, range=0..100), B=B)
boxrec = BoxRectangle(Rectangle=rectangle.Rectangle, Height=number_slider_3)
division = Division(A=multiplication, B=relay)
filter = StreamFilter(Gate=G, Stream0=division, Stream1=multiplication)
pop3d = Populate3D(Region=boxrec, Count=filter, Seed=number_slider_3)
lng = ListLength(List=pop3d)
dom_3 = ConstructDomain(DomainStart=0, DomainEnd=360)
division_2 = Division(A=relay, B=2)
dom_4 = ConstructDomain(DomainStart=3, DomainEnd=4)
random = Random(Range=dom_3, Number=lng, Seed=relay)
random_2 = Random(Range=dom_3, Number=lng, Seed=division_2)
random_3 = Random(Range=dom_4, Number=lng, Seed=division_2)  # -> graft(Random)
Y = UnitY(Factor=1)
X = UnitX(Factor=1)
int = Integer(random_3)
vrot = Rotate(Vector=X, Axis=pop3d, Angle=degrees(random))
vrot_2 = Rotate(Vector=Y, Axis=pop3d, Angle=degrees(random_2))
pl = ConstructPlane(Origin=pop3d, XAxis=vrot, YAxis=vrot_2)  # -> graft(Plane)
division_3 = Division(A=relay, B=2)
gate = StreamGate(Stream=pl, Gate=G)  # -> Target0, Target1
box = CenterBox(Base=gate.Target1, X=relay, Y=1, Z=division_3)
equals = Equality(FirstNumber=int, SecondNumber=3)  # -> Equality, Inequality
dispatch = Dispatch(List=box, DispatchPattern=equals.Equality)  # -> ListA, ListB
division_4 = Division(A=relay, B=10)
deplane = DeconstructPlane(Plane=gate.Target0)  # -> Origin, XAxis, YAxis, ZAxis
pop3d_2 = Populate3D(Region=dispatch.ListB, Count=int, Seed=relay)
pop3d_3 = Populate3D(Region=dispatch.ListA, Count=int, Seed=relay)
cir = Circle(Plane=gate.Target0, Radius=relay)
amp = Amplitude(Vector=deplane.ZAxis, Amplitude=division_4)
clean = CleanTree(RemoveNulls=True, RemoveInvalid=True, RemoveEmpty=True, Tree=pop3d_2)
clean_2 = CleanTree(RemoveNulls=True, RemoveInvalid=True, RemoveEmpty=True, Tree=pop3d_3)
extr = Extrude(Base=cir, Direction=amp)
conmesh = ConstructMesh(Vertices=clean, Faces={A=0, B=1, C=2, D=3})
conmesh_2 = ConstructMesh(Vertices=clean_2, Faces={A=0, B=1, C=2, D=2})
cap = CapHoles(Brep=extr)
merge = Merge(Data1=conmesh_2, Data2=conmesh)  # -> flatten(Result)
filter_2 = StreamFilter(Gate=G, Stream0=cap, Stream1=merge)
s_1 = ClusterOutput(filter_2)

# ==== cluster Size_2
number_slider = Slider(70, range=0..200)
number_slider_2 = Slider(10, range=0..10)
positionz = Slider(44, range=0..1000)
B = ClusterInput()
relay = ClusterInput()
neg = Negative(Value=number_slider)
neg_2 = Negative(Value=number_slider_2)
G = ClusterInput()
pt = ConstructPoint(XCoordinate=0, YCoordinate=0, ZCoordinate=positionz)
dom = ConstructDomain(DomainStart=number_slider, DomainEnd=neg)
dom_2 = ConstructDomain(DomainStart=number_slider_2, DomainEnd=neg_2)
number_slider_3 = Slider(2, range=0..10)
rectangle = Rectangle(Plane=pt, XSize=dom, YSize=dom_2, Radius=0)  # -> Rectangle, Length
multiplication = Multiplication(A=Slider(100, range=0..100), B=B)
boxrec = BoxRectangle(Rectangle=rectangle.Rectangle, Height=number_slider_3)
division = Division(A=multiplication, B=relay)
filter = StreamFilter(Gate=G, Stream0=division, Stream1=multiplication)
pop3d = Populate3D(Region=boxrec, Count=filter, Seed=number_slider_3)
lng = ListLength(List=pop3d)
dom_3 = ConstructDomain(DomainStart=0, DomainEnd=360)
division_2 = Division(A=relay, B=2)
dom_4 = ConstructDomain(DomainStart=3, DomainEnd=4)
random = Random(Range=dom_3, Number=lng, Seed=relay)
random_2 = Random(Range=dom_3, Number=lng, Seed=division_2)
random_3 = Random(Range=dom_4, Number=lng, Seed=division_2)  # -> graft(Random)
Y = UnitY(Factor=1)
X = UnitX(Factor=1)
int = Integer(random_3)
vrot = Rotate(Vector=X, Axis=pop3d, Angle=degrees(random))
vrot_2 = Rotate(Vector=Y, Axis=pop3d, Angle=degrees(random_2))
pl = ConstructPlane(Origin=pop3d, XAxis=vrot, YAxis=vrot_2)  # -> graft(Plane)
division_3 = Division(A=relay, B=2)
gate = StreamGate(Stream=pl, Gate=G)  # -> Target0, Target1
box = CenterBox(Base=gate.Target1, X=relay, Y=1, Z=division_3)
equals = Equality(FirstNumber=int, SecondNumber=3)  # -> Equality, Inequality
dispatch = Dispatch(List=box, DispatchPattern=equals.Equality)  # -> ListA, ListB
division_4 = Division(A=relay, B=10)
deplane = DeconstructPlane(Plane=gate.Target0)  # -> Origin, XAxis, YAxis, ZAxis
pop3d_2 = Populate3D(Region=dispatch.ListB, Count=int, Seed=relay)
pop3d_3 = Populate3D(Region=dispatch.ListA, Count=int, Seed=relay)
cir = Circle(Plane=gate.Target0, Radius=relay)
amp = Amplitude(Vector=deplane.ZAxis, Amplitude=division_4)
clean = CleanTree(RemoveNulls=True, RemoveInvalid=True, RemoveEmpty=True, Tree=pop3d_2)
clean_2 = CleanTree(RemoveNulls=True, RemoveInvalid=True, RemoveEmpty=True, Tree=pop3d_3)
extr = Extrude(Base=cir, Direction=amp)
conmesh = ConstructMesh(Vertices=clean, Faces={A=0, B=1, C=2, D=3})
conmesh_2 = ConstructMesh(Vertices=clean_2, Faces={A=0, B=1, C=2, D=2})
cap = CapHoles(Brep=extr)
merge = Merge(Data1=conmesh_2, Data2=conmesh)  # -> flatten(Result)
filter_2 = StreamFilter(Gate=G, Stream0=cap, Stream1=merge)
s_0 = ClusterOutput(filter_2)
